# Grasshopper definition picui-pipeline-fixture.gh (Grasshopper 1.0.8)
# plug-ins: Glaux Urb

file_path = FilePath("data\streets.shp")
file_path_2 = FilePath("data\curbs.shp")
file_path_3 = FilePath("data\blocks.shp")
import_shapefile = ImportShapefile(FilePath=file_path, Encoding="Auto", Run=True)  # -> Curves, Surfaces, Points, FieldNames, AttributesTree, Attributes, GeometryByFeature, GISFeatures, CRS, EncodingInfo
import_shapefile_2 = ImportShapefile(FilePath=file_path_3, Encoding="Auto", Run=True)  # -> Curves, Surfaces, Points, FieldNames, AttributesTree, Attributes, GeometryByFeature, GISFeatures, CRS, EncodingInfo
import_shapefile_3 = ImportShapefile(FilePath=file_path_2, Encoding="Auto", Run=True)  # -> Curves, Surfaces, Points, FieldNames, AttributesTree, Attributes, GeometryByFeature, GISFeatures, CRS, EncodingInfo
number_slider = Slider(1, range=0..10)
list_item = ListItem(List=import_shapefile.Attributes, Index=number_slider, Wrap=True)
list_item_2 = ListItem(List=import_shapefile.FieldNames, Index=number_slider, Wrap=True)
flatten_tree = FlattenTree(Tree=list_item, Path="{0}")
panel = Panel(list_item)
construct_domain = ConstructDomain(DomainStart=Slider(3, range=0..10), DomainEnd=Slider(10, range=0..10))
street_profile_definition = StreetProfileDefinition(Street=flatten_tree, StreetType="Custom", Lane=construct_domain)  # -> StreetProfile, ProfileElements, ProfilePreview
street_profile_assignment = StreetProfileAssignment(
    LogradourosGIS=file_path,
    StreetProfiles=street_profile_definition.StreetProfile,
    StreetNameField=list_item_2,
    MatchingMode=Slider(0, range=0..1),
    Run=True)  # -> ProfiledStreets, MatchedCurves, UnmatchedCurves, AmbiguousCurves, AssignmentReport
road_transversals_from_gis = RoadTransversalsFromGIS(
    LogradourosAxis=street_profile_assignment.ProfiledStreets,
    QuadrasBlocks=import_shapefile_2.Curves,
    MeiosFiosCurbs=import_shapefile_3.Curves,
    MaximumSectionSpacing=25,
    SearchRadius=Slider(12, range=0..100),
    SidewalkMode=Slider(1, range=0..1),
    MinimumSidewalkWidth=Slider(1.5, range=0..10),
    MinRoadwayWidth=Slider(6, range=0..10),
    StreetNameField=list_item_2,
    Run=True)  # -> TransversalLines, SectionPoints, CSVOutput, WidthsSummary, DiagnosticReport, CandidateTransversals, RejectedTransversals, RejectionReasons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
geometry = Geometry(road_transversals_from_gis.FixedStreetBoundary)
geometry_2 = Geometry(road_transversals_from_gis.PlannedCurbBoundary)
geometry_3 = Geometry(road_transversals_from_gis.PlannedSectionPoints)
street_profile_fitting = StreetProfileFitting(
    SectionPoints=road_transversals_from_gis.SectionPoints,
    StreetPathIndex=-1,
    Run=True,
    SectionMetadata=road_transversals_from_gis.SectionMetadata,
    ProfiledSections=road_transversals_from_gis.ProfiledSections)  # -> AdaptedProfiles, FittedSectionPoints, FittingConflicts, FittedStreetProfiles, FittingReport
road_cross_section_csv = RoadCrossSectionCSV(
    OneWay=False,
    MedianWidth=0,
    OriginPlane=PlaneXZ(0, 0, 0),
    DefaultBombeo=2,
    LayerDepths="0.05, 0.15, 0.20, 0.30",
    CurbProfile="0.15, 0.15, 0.25",
    LayoutGrid="2, 6.0, 25.0",
    DrawAnnotations=True,
    CustomLabels="Passeio, Pista, Canteiro",
    Run=True)  # -> SectionCurves, SectionSurfaces, Road3D, Annotations, KeyPoints, QuantitiesReport, HatchCurves, AdaptiveRoadElements, AdaptiveElementLabels, AdaptiveReport
